# Grasshopper definition grasshopper_to_place_cone.gh (Grasshopper 1.0.8)

series = Series(Start=0, Step=-300, Count=3)
number_slider = Slider(150, range=0..5000)
number_slider_2 = Slider(80, range=0..1000)
number_slider_3 = Slider(406.4, range=0..1000)
number_slider_4 = Slider(5, range=1..50)
panel_2 = Panel("Total Shapes: ")
number_slider_5 = Slider(85, range=0..200)
series_2 = Series(Start=0, Step=Slider(200, range=0..1000), Count=number_slider_4)
division = Division(A=number_slider_3, B=2)
pt = ConstructPoint(XCoordinate=number_slider_2, YCoordinate=number_slider, ZCoordinate=0)
multiplication = Multiplication(A=number_slider_4, B=2)
subtraction = Subtraction(A=number_slider_3, B=number_slider_2)
addition = Addition(A=number_slider, B=Slider(157, range=-1000..1000))
Y = UnitY(Factor=series)
rectangle = Rectangle(Plane=PlaneXY(0, 0, 0), XSize=number_slider_3, YSize=Slider(2679.7, range=0..5000), Radius=0)  # -> Rectangle, Length
pt_2 = ConstructPoint(XCoordinate=division, YCoordinate=-500, ZCoordinate=0)
concat = Concatenate(FragmentA="Total Shapes: ", FragmentB=multiplication)
cir = Circle(Plane=pt, Radius=number_slider_5)
pt_3 = ConstructPoint(XCoordinate=subtraction, YCoordinate=addition, ZCoordinate=0)
Y_2 = UnitY(Factor=series_2)
move = Move(Geometry=pt_2, Motion=Y)  # -> Geometry, Transform
cir_2 = Circle(Plane=pt_3, Radius=number_slider_5)
merge = Merge(Data1=cir, Data2=cir_2)
move_2 = Move(Geometry=graft(merge), Motion=Y_2)  # -> Geometry, Transform
rint = RegionIntersection(CurvesA=move_2.Geometry, CurvesB=rectangle.Rectangle)
runion = RegionUnion(Curves=move_2.Geometry)
boundary = BoundarySurfaces(Edges=move_2.Geometry)
area = Area(Geometry=flatten(rint))  # -> Area, Centroid
area_2 = Area(Geometry=flatten(boundary))  # -> Area, Centroid
area_3 = Area(Geometry=runion)  # -> Area, Centroid
ma = MassAddition(Input=flatten(area.Area))  # -> Result, PartialResults
ma_2 = MassAddition(Input=flatten(area_3.Area))  # -> Result, PartialResults
ma_3 = MassAddition(Input=flatten(area_2.Area))  # -> Result, PartialResults
subtraction_2 = Subtraction(A=ma_3.Result, B=ma.Result)
subtraction_3 = Subtraction(A=ma_3.Result, B=ma_2.Result)
larger = LargerThan(FirstNumber=subtraction_2, SecondNumber=1)  # -> LargerThan, OrEqualTo
larger_2 = LargerThan(FirstNumber=subtraction_3, SecondNumber=1)  # -> LargerThan, OrEqualTo
filter = StreamFilter(Gate=larger.LargerThan, Stream0="Edge: OK", Stream1="Edge: COLLISION")
filter_2 = StreamFilter(Gate=larger_2.LargerThan, Stream0="Shapes: OK", Stream1="Shapes: OVERLAP")
addition_2 = Addition(A=larger.LargerThan, B=larger_2.LargerThan)
ma_4 = MassAddition(Input=flatten(addition_2))  # -> Result, PartialResults
merge_2 = Merge(Data1=[filter, filter_2], Data2=concat)
larger_3 = LargerThan(FirstNumber=addition_2, SecondNumber=0)  # -> LargerThan, OrEqualTo
larger_4 = LargerThan(FirstNumber=ma_4.Result, SecondNumber=0)  # -> LargerThan, OrEqualTo

# ---- group: Display Logic
filter_3 = StreamFilter(
    Gate=larger_4.LargerThan,
    Stream0=ColourSwatch(SwatchColor=RGB(0, 255, 34)),
    Stream1=ColourSwatch(SwatchColor=RGB(0, 85, 255)))
preview = CustomPreview(Geometry=move_2.Geometry, Material=filter_3)
tag = TextTag3D(Location=move.Geometry, Text=merge_2, Size=80, Colour=filter_3, Justification=move.Geometry)
